# Grasshopper definition day light factor.gh (Grasshopper 1.0.8)

unit_z = UnitZ(Factor=Slider(300, range=0..1000))
brep = Brep([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])
extrude = Extrude(Base=brep, Direction=unit_z)

# ---- group: Opaque Faces
panel = Panel("classrooms")

# ----
roomsolid = HBRoomFromSolid(geo=flatten(extrude), name=panel, conditioned=True)  # -> out, rooms; plug-in component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

# ---- group: centrality
panel_2 = Panel("C:\Users\DD\Desktop\IAAC\Graph ML\Homework\02\centrality.csv")
python_3_script = Python3Script(filepath=panel_2, run=Toggle(True))  # -> cent_pts, cent_vals
# ---------- python_3_script: Python ----------
import csv
import Rhino.Geometry as rg

filepath = filepath.strip()
pts = []
vals = []

if run:
    with open(filepath, 'r') as f:
        reader = csv.DictReader(f)
        for row in reader:
            pt = rg.Point3d(float(row['x']), float(row['y']), float(row['z']))
            pts.append(pt)
            vals.append(float(row['closeness']))
# ---------- end python_3_script ----------

# ----
panel_3 = Panel("https://energyplus-weather.s3.amazonaws.com/europe_wmo_region_6/SVN/SVN_Ljubljana.130140_IWEC/SVN_Ljubljana.130140_IWEC.zip")
downloadepw = LBDownloadWeather(weather_URL=panel_3)  # -> epw_file, stat_file, ddy_file; plug-in component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
wea = HBWeaFromEPW(epw_file=downloadepw.epw_file)  # -> wea; plug-in component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
construct_domain = ConstructDomain(DomainStart=Slider(18, range=0..100), DomainEnd=Slider(356, range=100..500))
unit_z_2 = UnitZ(Factor=1)
panel_4 = Panel("C:\Users\DD\Desktop\IAAC\Graph ML\Homework\02\daylight.csv")

# ---- group: daylight
python_3_script_2 = Python3Script(filepath=panel_4, run=Toggle(True))  # -> df_pts, df_vals
# ---------- python_3_script_2: Python ----------
import csv
import Rhino.Geometry as rg

filepath = filepath.strip()
pts = []
vals = []

if run:
    with open(filepath, 'r') as f:
        reader = csv.DictReader(f)
        for row in reader:
            pt = rg.Point3d(float(row['x']), float(row['y']), float(row['z']))
            pts.append(pt)
            vals.append(float(row['df']))
# ---------- end python_3_script_2 ----------

# ----
python_3_script_3 = Python3Script(cent_filepath=panel_2, df_filepath=panel_4)  # -> heights, matched_df, cent_pts; inputs cent_filepath: String, df_filepath: String
# ---------- python_3_script_3: Python ----------
import math
import csv
import Rhino.Geometry as rg

# --- load centrality CSV ---
cent_pts = []
cent_vals = []
with open(cent_filepath.strip(), 'r') as f:
    for row in csv.DictReader(f):
        cent_pts.append(rg.Point3d(float(row['x']), float(row['y']), float(row['z'])))
        cent_vals.append(float(row['closeness']))

# --- load daylight CSV ---
df_pts = []
df_vals = []
with open(df_filepath.strip(), 'r') as f:
    for row in csv.DictReader(f):
        df_pts.append(rg.Point3d(float(row['x']), float(row['y']), float(row['z'])))
        df_vals.append(float(row['df']))

print(f"centrality: {len(cent_pts)} pts, daylight: {len(df_pts)} pts")

def get_centroid(points):
    cx = sum(float(p.X) for p in points) / len(points)
    cy = sum(float(p.Y) for p in points) / len(points)
    return cx, cy

def nearest_index(px, py, candidates_x, candidates_y):
    min_dist = float('inf')
    min_idx = 0
    for i in range(len(candidates_x)):
        dx = px - candidates_x[i]
        dy = py - candidates_y[i]
        dist = dx*dx + dy*dy
        if dist < min_dist:
            min_dist = dist
            min_idx = i
    return min_idx, math.sqrt(min_dist)

def normalize(vals):
    mn = min(vals)
    mx = max(vals)
    rng = mx - mn
    if rng == 0:
        return [0.0] * len(vals)
    return [(v - mn) / rng for v in vals]

# center both point clouds
cx_cent, cy_cent = get_centroid(cent_pts)
cx_df,   cy_df   = get_centroid(df_pts)

cent_x = [float(p.X) - cx_cent for p in cent_pts]
cent_y = [float(p.Y) - cy_cent for p in cent_pts]
df_x   = [float(p.X) - cx_df   for p in df_pts]
df_y   = [float(p.Y) - cy_df   for p in df_pts]

cent_n = normalize(cent_vals)
df_n   = normalize(df_vals)

scale   = 1000
heights = []
matched_df = []
match_distances = []

for i in range(len(cent_pts)):
    idx, dist = nearest_index(cent_x[i], cent_y[i], df_x, df_y)
    delta = cent_n[i] - df_n[idx]
    heights.append(delta * scale)
    matched_df.append(float(df_vals[idx]))
    match_distances.append(dist)

import ghpythonlib.components as ghcomp
ghenv.Component.Message = f"matched {len(heights)} | max dist {max(match_distances):.0f} | {min(heights):.0f} to {max(heights):.0f}"
# already computed above — just make sure it's listed as an output
cent_pts = cent_pts  # output
# ---------- end python_3_script_3 ----------
point = Point(python_3_script_3.cent_pts)
unit_z_3 = UnitZ(Factor=python_3_script_3.matched_df)
circle = Circle(Plane=point, Radius=Slider(23, range=0..100))
bounds = Bounds(Numbers=unit_z_3)
boundary_surfaces = BoundarySurfaces(Edges=circle)
remap_numbers = RemapNumbers(Value=unit_z_3, Source=bounds, Target=construct_domain)  # -> Mapped, Clipped
amplitude = Amplitude(Vector=unit_z_2, Amplitude=remap_numbers.Mapped)
extrude_2 = Extrude(Base=boundary_surfaces, Direction=amplitude)

# ---- group: Apertures
# Geometry Preparation
brep_2 = Brep([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])
glassmod = HBGlassModifier(name="g_material", trans="0.55")  # -> modifier; plug-in component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
aperture = HBAperture(geo=brep_2, rad_mod=glassmod)  # -> report, apertures; plug-in component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

# ----
addsubface = HBAddSubface(hb_obj=flatten(roomsolid.rooms), sub_faces=flatten(aperture.apertures), project_dist=Slider(10, range=0..10))  # -> out, hb_obj, unmatched; plug-in component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

# ---- group: Apertures (continued)
bordershades = HBExtrudedBorderShades(hb_objs=flatten(addsubface.hb_obj), depth="0.3")  # -> report, hb_objs; plug-in component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

# ----
# Model + Grids
panel_5 = Panel("sample_model_grid")
gridrooms = HBSensorGridFromRooms(rooms=bordershades.hb_objs, grid_size="100")  # -> grid, points, mesh; plug-in component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

model = HBModel(rooms=flatten(bordershades.hb_objs), name=panel_5)  # -> out, model; plug-in component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

assigngridsviews = HBAssignGridsAndViews(model=model.model, grids=flatten(gridrooms.grid))  # -> model; plug-in component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
vizwiref = HBVisualizeWireframe(hb_objs=flatten(model.model))  # -> geo; plug-in component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

flatten_tree = FlattenTree(Tree=gridrooms.points, Path="{0}")

# ----
# Run Recipe
toggle = BooleanToggle(False)
annualdaylight = HBAnnualDaylight(model=assigngridsviews, wea=wea, enhanced=toggle, run=Toggle(True))  # -> report, results, DA, cDA, UDI, UDI_low, UDI_up; plug-in component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

# ----
# Compute sDA
sda = HBSpatialDaylightAutonomy(DA=annualdaylight.DA)  # -> report, sDA, pass_fail; disabled; plug-in component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
sda_in_each_room = Panel(sda.sDA)  # disabled

# ----
# Visualize Daylight Autonomy
mjoin = MeshJoin(Meshes=gridrooms.mesh)
data = Data(flatten(annualdaylight.DA))
heatmap = LBSpatialHeatmap(values=data, mesh=mjoin, legend_title="%")  # -> mesh, legend, title, colors, legend_par, vis_set; plug-in component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

panel_6 = Panel(data)
param_viewer = ParamViewer(data)
python_3_script_4 = Python3Script(pts=flatten_tree, values=data, filepath=panel_4, write=Toggle(True))  # -> out, a; inputs pts: list of Point3d, values: list
# ---------- python_3_script_4: Python ----------
import csv

filepath = filepath.strip()   # <-- add this as the first line

if write:
    with open(filepath, 'w', newline='') as f:
        writer = csv.writer(f)
        writer.writerow(['x', 'y', 'z', 'df'])
        for pt, val in zip(pts, values):
            writer.writerow([pt.X, pt.Y, pt.Z, val])
    print(f"wrote {len(pts)} rows")
else:
    print("toggle write to True to export")
# ---------- end python_3_script_4 ----------
